# Grasshopper definition layout_analysis.gh (Grasshopper 1.0.7)
# plug-ins: Kangaroo2 Components, Super Delaunay 2d, ScriptParasite, Shortest Walk in Gh, Human, DeCodingSpaces, Heteroptera, EleFront, Human UI, treesloth01

layout_curves = Curve(flatten([<curve referenced from the Rhino model> x5]))

# ---- group: Normalization
reallength = Slider(1.27, range=0..10)
reference_line = Line(Line((79.40283588, 39.84129861, 0), (80.63795883, 39.54360231, 0)))

# ---- group: YTI Parameters
visualize_yti = BooleanToggle(True)
yti_maximal_path_width = Slider(0.02, range=0..1)
number_slider = Slider(0.1, range=0..10)
yti_node_size = Slider(0.245, range=0.1..5)

# ---- group: SCI Parameters
visualize_sci = BooleanToggle(False)
isovist_sample_distance = Slider(0.2, range=0.1..2)
sci_vantage_point_size = Slider(0.1, range=0.1..1)
use_gpu = BooleanToggle(False)
noise_strength = Slider(0.01, range=0..1)
samples_per_curve = Slider(10, range=1..1000)
number_of_beds_per_patient_room = Number(1)

# ----
boundary = BoundarySurfaces(Edges=layout_curves)

# ---- group: Split Boundary in Straight Segments
topoly = CurveToPolyline(Curve=layout_curves, ToleranceDistance=0, ToleranceAngle=0)  # -> Polyline, Segments
explode = Explode(Curve=topoly.Polyline, Recursive=True)  # -> reparameterize(flatten(Segments)), Vertices
pairwisesplitting = CSharpScript(Segments=explode.Segments)  # -> out, PairwiseSplitSegments; inputs Segments: list of Curve
# ---------- pairwisesplitting: C# usings ----------
using Rhino.Geometry.Intersect;
# ---------- pairwisesplitting: C# ----------
    List<Curve> pairwiseSplitCurves = new List<Curve>();
    foreach (Curve seg0 in Segments)
    {
      List<double> splitParams = new List<double>();
      foreach (Curve seg1 in Segments)
      {
        if (seg0 == seg1)
        {
          continue;
        }
        CurveIntersections intersects = Intersection.CurveCurve(seg0, seg1, 0.1, 0.1);
        if (intersects == null)
        {
          continue;
        }
        foreach (IntersectionEvent intersect in intersects)
        {
          if (intersect.IsPoint)
          {
            splitParams.Add(intersect.ParameterA);
          }
        }
      }
      if (splitParams.Count == 0)
      {
        // No intersection.
        pairwiseSplitCurves.Add(seg0);
      }
      Curve[] splitCurves = seg0.Split(splitParams);
      Print(splitCurves.Length.ToString());
      if (splitCurves == null)
      {
        throw new Exception("Splitting curve did not yield correct result.");
      }
      pairwiseSplitCurves.AddRange(splitCurves);
    }
    PairwiseSplitSegments = pairwiseSplitCurves;
# ---------- end pairwisesplitting ----------
dupln = RemoveDuplicateLines(Lines=pairwisesplitting.PairwiseSplitSegments, Tolerance=0.01)

# ---- group: All Points that could possibly be corners of the layout curves
crv = Curve(dupln)
disc = Discontinuity(Curve=layout_curves, Level=1)  # -> flatten(Points), Parameters
end = EndPoints(Curve=crv)  # -> Start, End
pt = Point(flatten([disc.Points, end.Start, end.End]))

# ----
pt_2 = Point(pt)
cullpt = CullDuplicates(Points=pt_2, Tolerance=0.1, CullMode=3)  # -> Points, Indices, Valence
del = DelaunayMesh(Points=cullpt.Points, Plane=PlaneXY(0, 0, 0))
delaunay = Delaunay(Points=cullpt.Points)  # -> Delaunay, Edges, EdgesTopology
number_slider_2 = Slider(0, range=0..20)
demesh = DeconstructMesh(Mesh=del)  # -> Vertices, Faces, Colours, Normals
deface = DeconstructFace(Face=demesh.Faces)  # -> CornerA, CornerB, CornerC, CornerD

panel = Panel("C:\Users\rapha\Documents\EBDToolkit\GrasshopperPlugin\ScriptParasite")
remesh = CSharpScript(
    idxsCornerA=deface.CornerA,
    idxsCornerB=deface.CornerB,
    idxsCornerC=deface.CornerC,
    layoutLines=dupln,
    vertices=demesh.Vertices)  # -> out, idxsCornerAOut, idxsCornerBOut, idxsCornerCOut; inputs idxsCornerA: list of Int32, idxsCornerB: list of Int32, idxsCornerC: list of Int32, layoutLines: list of Line, vertices: list of Point3d
# ---------- remesh: C# usings ----------
using System.Linq;
# ---------- remesh: C# ----------
    // indices should have the same length
    if (idxsCornerA.Count != idxsCornerB.Count || idxsCornerA.Count != idxsCornerC.Count)
    {
      throw new Exception("All input lists should have the same length.");
    }

    // Create triangles.
    List<List<int>> triangles = new List<List<int>>();
    for (int i = 0; i < idxsCornerA.Count; i++)
    {
      triangles.Add(new List<int> { idxsCornerA[i], idxsCornerB[i], idxsCornerC[i] });
    }

    // Create half-edge data structure.
    Tuple<List<Vertex>, List<HalfEdge>, List<Face>> halfEdgeDatastructure = CreateHalfEdgeDataStructure(triangles, vertices);
    List<Vertex> vertexList = halfEdgeDatastructure.Item1;
    List<HalfEdge> halfEdgeList = halfEdgeDatastructure.Item2;
    List<Face> faceList = halfEdgeDatastructure.Item3;

    // Iterate over all layout lines and check for all "inner" half-edges if they intersect with the layout line.
    // If so, flip the half-edge.
    foreach (Line layoutLine in layoutLines)
    {
      foreach (HalfEdge he in halfEdgeList)
      {
        if (he.Face == null)
        {
          continue;
        }

        if (he.Twin == null)
        {
          continue;
        }

        // Skip if the lines are the same.
        Point3d heStart = he.Origin.Pos;
        Point3d heEnd = he.Next.Origin.Pos;
        if (IsSameLine(layoutLine.From, layoutLine.To, heStart, heEnd))
        {
          continue;
        }

        LineCurve halfEdgeLine = new LineCurve(heStart, heEnd);
        LineCurve layoutLineCurve = new LineCurve(layoutLine);

        // Compute intersection.
        var intersectionResult = Rhino.Geometry.Intersect.Intersection.CurveCurve(layoutLineCurve, halfEdgeLine, 0.1, 0.1);

        // If there is no intersection, continue.
        if (intersectionResult.Count == 0)
        {
          continue;
        }

        // There should be exactly one intersection event.
        if (intersectionResult.Count != 1)
        {
          continue;
        }

        // and that intersection should be a point.
        if (!(intersectionResult[0].IsPoint))
        {
          continue;
        }

        // Check if the intersection point coincides with the start or end point of the half-edge, in that case, 
        // it is not a crossing and we can continue.
        Point3d intersectionPoint = intersectionResult[0].PointA;
        if (intersectionPoint.DistanceTo(halfEdgeLine.PointAtStart) < 0.1 || intersectionPoint.DistanceTo(halfEdgeLine.PointAtEnd) < 0.1)
        {
          continue;
        }

        // Flip the half-edge.
        FlipEdge(he, halfEdgeList, vertexList, faceList);
      }
    }

    // Output the updated indices.
    List<int> idxsCornerAOut_ = new List<int>();
    List<int> idxsCornerBOut_ = new List<int>();
    List<int> idxsCornerCOut_ = new List<int>();
    foreach (Face face in faceList)
    {
      HalfEdge he = face.HalfEdge;
      idxsCornerAOut_.Add(he.Origin.Index);
      idxsCornerBOut_.Add(he.Next.Origin.Index);
      idxsCornerCOut_.Add(he.Next.Next.Origin.Index);
    }
    idxsCornerAOut = idxsCornerAOut_;
    idxsCornerBOut = idxsCornerBOut_;
    idxsCornerCOut = idxsCornerCOut_;
# ---------- remesh: C# additional code ----------
  public class Vertex
  {
    public Point3d Pos;
    public int Index;

    // The edge that starts at this vertex
    public HalfEdge Edge;

    public Vertex(Point3d pos, int index)
    {
      this.Pos = pos;
      this.Index = index;
    }

  }

  public class HalfEdge
  {
    public Vertex Origin;
    public HalfEdge Twin;
    public HalfEdge Next;
    public HalfEdge Prev;
    public Face Face;

    public HalfEdge(Vertex origin)
    {
      this.Origin = origin;
    }
  }

  public class Face
  {
    public HalfEdge HalfEdge;

    public Face(HalfEdge halfEdge)
    {
      this.HalfEdge = halfEdge;
    }
  }

  // Creates half-edge datastructure
  public Tuple<List<Vertex>, List<HalfEdge>, List<Face>> CreateHalfEdgeDataStructure(List<List<int>> triangles, List<Point3d> vertices)
  {

    List<Vertex> vertexList = new List<Vertex>();
    List<HalfEdge> halfEdgeList = new List<HalfEdge>();
    List<Face> faceList = new List<Face>();

    // Initialize the vertices.
    for (int i = 0; i < vertices.Count; i++)
    {
      vertexList.Add(new Vertex(vertices[i], i));
    }

    // Create half-edges.
    // This dictionary remembers if a specific edge has been added before.
    Dictionary<Tuple<int, int>, HalfEdge> edgeDict = new Dictionary<Tuple<int, int>, HalfEdge>();
    foreach (List<int> triangle in triangles)
    {
      HalfEdge[] triangleEdges = new HalfEdge[3];

      for (int i = 0; i < 3; i++)
      {
        int startIndex = triangle[i];
        int endIndex = triangle[(i + 1) % 3];
        Tuple<int, int> edgeKey = new Tuple<int, int>(startIndex, endIndex);
        Tuple<int, int> twinEdgeKey = new Tuple<int, int>(endIndex, startIndex);

        HalfEdge edge;
        HalfEdge twinEdge;
        if (!edgeDict.TryGetValue(edgeKey, out edge))
        {

          // Edge was not yet created, create new half-edge
          edge = new HalfEdge(vertexList[startIndex]);
          halfEdgeList.Add(edge);
          edgeDict[edgeKey] = edge;
        }

        // Check if twin edge exists
        if (edgeDict.TryGetValue(twinEdgeKey, out twinEdge))
        {
          edge.Twin = twinEdge;
          twinEdge.Twin = edge;
        }

        triangleEdges[i] = edge;
      }

      // Link half-edges together
      for (int i = 0; i < 3; i++)
      {
        triangleEdges[i].Next = triangleEdges[(i + 1) % 3];
        triangleEdges[i].Prev = triangleEdges[(i + 2) % 3];
      }

      // Create face and link it to the half-edges
      Face face = new Face(triangleEdges[0]);
      faceList.Add(face);
      foreach (HalfEdge he in triangleEdges)
      {
        he.Face = face;
      }
    }

    // Link half-edges to vertices
    foreach (HalfEdge he in halfEdgeList)
    {
      if (he.Origin.Edge == null)
      {
        he.Origin.Edge = he;
      }
    }

    return Tuple.Create(vertexList, halfEdgeList, faceList);
  }

  /// <summary>
  /// Implements flip edge operation on a half-edge datastructure.
  /// Based on: https://jerryyin.info/geometry-processing-algorithms/half-edge/
  ///              e9
  ///     ------------------->
  ///   v1<-------------------v2
  ///   ^|^\       e5         ^|
  ///   || \\                 ||
  ///                            cut for space
  ///   ||        \\          ||
  /// e6||e0     e2\\e3     e4||e8
  ///   ||          \\        ||
  ///                            cut for space
  ///   ||                 \\ ||
  ///   |v         e1       \v|v
  ///   v3------------------->v4
  ///     <------------------
  ///              e7
  ///
  /// </summary>
  /// <param name="e">Half-edge to be flipped. wlog, e3 in the diagram</param>
  /// <param name="halfEdgeList">List of half-edges</param>
  /// <param name="vertexList">Vertices of half-edge datastructure</param>
  /// <param name="faceList">List of faces of half-edge datastructure</param>
  public void FlipEdge(HalfEdge e, List<HalfEdge> halfEdgeList, List<Vertex> vertexList, List<Face> faceList)
  {
    // Get snapshot of current local state.
    HalfEdge e5 = e.Prev;
    HalfEdge e4 = e.Next;
    HalfEdge twin = e.Twin;
    HalfEdge e1 = twin.Prev;
    HalfEdge e0 = twin.Next;

    foreach (HalfEdge he in new List<HalfEdge> { e0, e1, e4, e5 })
    {
      he.Origin.Edge = he;
      e1.Face.HalfEdge = e1;
      e5.Face.HalfEdge = e5;
    }

    // Recycle e and twin -> datastructure becomes inconsistent
    e.Next = e5;
    e.Prev = e0;
    e.Origin = e1.Origin;
    e.Face = e5.Face;
    twin.Next = e1;
    twin.Prev = e4;
    twin.Origin = e5.Origin;
    twin.Face = e1.Face;

    // Update e0, e1, e4, e5
    e0.Next = e;
    e1.Next = e4;
    e4.Next = twin;
    e5.Next = e0;
    e0.Prev = e5;
    e1.Prev = twin;
    e4.Prev = e1;
    e5.Prev = e;
  }

  public bool IsSameLine(Point3d start1, Point3d end1, Point3d start2, Point3d end2, double tol = 0.1)
  {
    return (start1.DistanceTo(start2) < tol && end1.DistanceTo(end2) < tol) || (start1.DistanceTo(end2) < tol && end1.DistanceTo(start2) < tol);
  }
# ---------- end remesh ----------
scriptpar = ScriptParasite(Enable=Toggle(True), Folder=panel)

create_layout_graph = GhPythonScript(
    corner_index_A=remesh.idxsCornerAOut,
    corner_index_B=remesh.idxsCornerBOut,
    corner_index_C=remesh.idxsCornerCOut,
    vertices=demesh.Vertices,
    boundary_edges=dupln,
    layout_surface=boundary,
    area_thresh=Slider(1, range=0..1))  # -> out, nodes, edges, surface_corners; inputs corner_index_A: list, corner_index_B: list, corner_index_C: list, vertices: list of Point3d, boundary_edges: list of Curve, layout_surface: Brep
# ---------- create_layout_graph: Python ----------
__author__ = "rapha"
__version__ = "2024.02.27"

import rhinoscriptsyntax as rs
import Rhino.Geometry as rg
from itertools import chain, combinations
import math
from ghpythonlib import treehelpers as th

def non_empty_subsets(lst):
    return list(chain.from_iterable(combinations(lst, r) for r in range(1, len(lst)+1)))

def compute_centroid(vertex_list):
    """
    Computes centroid of at least one vertex.
    """
    n_verts = len(vertex_list)
    if n_verts == 0:
        raise ValueError("Need at least one vertex to compute centroid")
    c = rg.Point3d(
        sum([v.X for v in vertex_list]) / n_verts,
        sum([v.Y for v in vertex_list]) / n_verts,
        sum([v.Z for v in vertex_list]) / n_verts
    )
    return c

# Helper function to calculate the polar angle of a vertex with respect to the centroid
def polar_angle(vertex, centroid):
    return math.atan2(vertex.Y - centroid.Y, vertex.X - centroid.X)

# Helper function to sort vertices based on their polar angle with respect to the centroid
def sort_vertices_by_angle(vertices):
    centroid = compute_centroid(vertices)
    return sorted(vertices, key=lambda x: polar_angle(x, centroid))

def check_convexity(vertices):

    # Helper function to calculate the cross product of two vectors
    def cross_product(a, b):
        return a.X * b.Y - a.Y * b.X

    # Calculate the centroid of the vertices
    centroid = compute_centroid(vertices)

    # Check convexity
    is_convex = True
    
    # Sort vertices based on their polar angle with respect to the centroid
    sorted_vertices = sort_vertices_by_angle(vertices)
    for vertex in sorted_vertices:
        n = len(sorted_vertices)
        for i in range(n):
            # Get three consecutive vertices
            p1 = sorted_vertices[i % n]
            p2 = sorted_vertices[(i + 1) % n]
            p3 = sorted_vertices[(i + 2) % n]

            # Calculate the cross product of the vectors formed by the consecutive vertices
            cross = cross_product(rg.Vector3d(p2.X - p1.X, p2.Y - p1.Y, 0), rg.Vector3d(p3.X - p2.X, p3.Y - p2.Y, 0))

            # Check if the cross product changes sign, indicating a non-convex region
            if cross < -0.1:  # Allowing some concavity
                is_convex = False
                break

    return is_convex

def merge(node_to_idxs, vertices, graph, curr_node, visited):
    """
    Invariant: Joins current partition with child partition such that:
    - the resulting partition remains convex
    - concurrency is respected
    Traverses the graph with DFS. Algorithm might not lead to expected
    partitioning for cyclic typologies.
    """
    # Set current node as visited
    visited[curr_node] = True
    
    # A convex partition
    convex_partition = node_to_idxs[curr_node]
    additional_partitions = {}
    for neighbor in graph[curr_node]:
        if visited[neighbor]:
            continue
        merge(node_to_idxs, vertices, graph, neighbor, visited)
        
        # Need to save it as dict such that we can retrieve the index later
        additional_partitions[neighbor] = node_to_idxs[neighbor]
    
    # For all subsets of additional partitions, check if the resulting partition
    # is still convex. If any will not be, we have concurrency and will not
    # merge.
    all_convex = True
    additional_partitions_list = [v for _, v in additional_partitions.items()]
    for additional_partition in non_empty_subsets(additional_partitions_list):
        potential_partition = [convex_partition] + list(additional_partition)
        unique_idxs = list(set([i for sublist in potential_partition for i in sublist]))
        unique_verts = [vertices[i] for i in unique_idxs]
        if not check_convexity(unique_verts):
            all_convex = False
            break
    
    # If at least one potential partition is not convex, continue
    if not all_convex:
        return
    
    # Else, we can merge the nodes. First, get the unique indices
    all_idxs = [i for sublist in [convex_partition] + additional_partitions_list for i in sublist]
    unique_idxs = list(set(all_idxs))
    
    # Update the current entry of the graph
    node_to_idxs[curr_node] = unique_idxs
    
    # Make former neighbors of the merged nodes point to the current node
    for merged_node in additional_partitions:
        
        # Clear list of neighbors
        del node_to_idxs[merged_node]
        for neighbors_neighbor in graph[merged_node]:
            graph[neighbors_neighbor].remove(merged_node)
            if neighbors_neighbor == curr_node:
                continue
            graph[curr_node].append(neighbors_neighbor)
            graph[neighbors_neighbor].append(curr_node)
    for merged_node in additional_partitions:
        del graph[merged_node]
    check_graph_consistency(graph, node_to_idxs)

def check_graph_consistency(graph, node_to_idxs):
    for node, neighbors in graph.items():
        for neighbor in neighbors:
            if neighbor not in graph:
                raise Exception("Node " + str(node) + " references node " + str(neighbor) + " as neighbor but not in graph")
    for node, neighbors in graph.items():
        for neighbor in neighbors:
            if node not in graph[neighbor]:
                raise Exception("Symmetry not upheld {" + str(node) + ": " + str(graph[node]) + "}, {" + str(neighbor) + ": " + str(graph[neighbor]) + "}")
    for node_A in node_to_idxs:
        if node_A not in graph:
            raise Exception("Node " + node_A + " is in node_to_idxs but not in graph")

def triangle_area(a, b, c):
    
    # Convert points to vectors AB and AC
    AB = (b.X - a.X, b.Y - a.Y)
    AC = (c.X - a.X, c.Y - a.Y)
    
    # Compute the cross product of vectors AB and AC
    cross_product = AB[0] * AC[1] - AB[1] * AC[0]
    
    # Compute the area of the triangle
    area = abs(cross_product) / 2
    return area

def check_line_overlap(line_A, line_B):
    A_start = rs.CurveStartPoint(line_A)
    A_end = rs.CurveEndPoint(line_A)
    B_start = rs.CurveStartPoint(line_B)
    B_end = rs.CurveEndPoint(line_B)
    same_dir = rs.Distance(A_start, B_start) < 0.1 and rs.Distance(A_end, B_end) < 0.1
    oppo_dir = rs.Distance(A_start, B_end) < 0.1 and rs.Distance(A_end, B_start) < 0.1
    return same_dir or oppo_dir

# create a mapping of centroids to list of indices into the points array
node_to_idxs = {i: [a, b, c] for i, (a, b, c) in enumerate(zip(corner_index_A, corner_index_B, corner_index_C))}
vertex_lists = [[vertices[vert_index] for vert_index in vert_indices] for _, vert_indices in node_to_idxs.items()]
centroids = [compute_centroid(l) for l in vertex_lists]

# Remove all triangles that do not lie on the surface
closest_points = [rs.BrepClosestPoint(layout_surface, centroids[i])[0] for i, _ in node_to_idxs.items()]
distance_to_surf = [rs.Distance(closest_points[i], centroids[i]) for i, _ in node_to_idxs.items()]
node_to_idxs = {i: v for i, v in node_to_idxs.items() if distance_to_surf[i] < 0.001}

# create connectivity
graph = {n: [] for n in node_to_idxs}
for node_A, idx_list_A in node_to_idxs.items():
    for node_B, idx_list_B in node_to_idxs.items():
        
        if node_A == node_B:
            continue
        
        # If the vertex list share at least two vertices, they share an edge and
        # should be connected unless the edge is a boundary
        shared_idxs = list(set(idx_list_A).intersection(set(idx_list_B)))
        if len(shared_idxs) != 2:
            continue
        
        # Check if the list of vertices coincides with one of the boundary edges
        vert_A = vertices[shared_idxs[0]]
        vert_B = vertices[shared_idxs[1]]
        is_boundary = False
        for boundary_edge in boundary_edges:
            if check_line_overlap(rg.LineCurve(vert_A, vert_B), boundary_edge):
                is_boundary = True
                break
        if is_boundary:
            continue
        if node_B not in graph[node_A]:
            graph[node_A].append(node_B)
        if node_A not in graph[node_B]:
            graph[node_B].append(node_A)

for node, neighbors in graph.items():
    if len(neighbors) > 1:
        continue
    
    assert len(neighbors) == 1, "Expected 1 neighbor, found " + str(len(neighbors))
    
    verts = [vertices[i] for i in node_to_idxs[node]]
    
    assert len(verts) == 3, "Expected triangle, but found " + str(len(verts)) + " vertices associated with node"
    
     # Compute triangle area using cross-product
     # Extract points A, B, and C
    area = triangle_area(*verts)
    
    # If area is smaller than area_threshold, remove the node
    if area < area_thresh:
        graph[neighbors[0]].remove(node)
        del graph[node]
        del node_to_idxs[node]

# Start merging process at the node with the maximum degree
node_degrees = [len(neighbors) for _, neighbors in graph.items()]
node_names = [n for n, _ in graph.items()]
argmax = node_names[node_degrees.index(max(node_degrees))]
visited = {n: False for n in graph}
merge(node_to_idxs, vertices, graph, argmax, visited)
check_graph_consistency(graph, node_to_idxs)

vertex_lists = {n: [vertices[v_idx] for v_idx in vert_indices] for n, vert_indices in node_to_idxs.items()}
centroids = {n: compute_centroid(l) for n, l in vertex_lists.items()}
nodes = [c for _, c in centroids.items()]

surface_corners = [[vertices[i] for i in sublist] for _, sublist in node_to_idxs.items()]
surface_corners = [sort_vertices_by_angle(verts) for verts in surface_corners]
surface_corners = th.list_to_tree(surface_corners)

nested_edges = [[rg.Line(centroids[i], centroids[j]) for j in neighbors] for i, neighbors in graph.items()]
edges = [edge for sublist in nested_edges for edge in sublist]
# ---------- end create_layout_graph ----------
pt_3 = Point(create_layout_graph.surface_corners)
pline = PolyLine(Vertices=pt_3, Closed=Toggle(True))
boundary_2 = BoundarySurfaces(Edges=pline)  # -> flatten(Surfaces)
item = ListItem(List=boundary_2, Index=Slider(70, range=0..116), Wrap=True)

nodes = Point(create_layout_graph.nodes)
edges = Curve(create_layout_graph.edges)

# ---- group: Graph Scaling Parameters
graph_size = Slider(15, range=1..50)
node_size = Slider(0.652, range=0..1)
margin = Slider(5, range=0..100)

# ----
node_positions = Point(nodes)
boundary_lines = Curve(dupln)
graph_edge_lines = Curve(edges)
end_2 = EndPoints(Curve=graph_edge_lines)  # -> Start, End

# ---- group: Compute displacement vector
all_points = Point([node_positions, end_2.Start])
devec = DeconstructVector(Vector=flatten([node_positions, all_points]))  # -> XComponent, YComponent, ZComponent
sort = SortList(Keys=devec.XComponent)  # -> Keys, ValuesA
sort_2 = SortList(Keys=devec.YComponent)  # -> Keys, ValuesA
first_last = FirstLast(List=sort.Keys)  # -> FirstValue, LastValue
first_last_2 = FirstLast(List=sort_2.Keys)  # -> FirstValue, LastValue
number = Number(-1)
min_x = Number(first_last.FirstValue)
max_y = Number(first_last_2.LastValue)
multiplication = Multiplication(A=margin, B=number)
neg_min_y = Multiplication(A=min_x, B=number)
neg_max_y = Multiplication(A=max_y, B=number)
vec = VectorXYZ(XComponent=margin, YComponent=multiplication, ZComponent=0)  # -> Vector, Length
vec_2 = VectorXYZ(XComponent=neg_min_y, YComponent=neg_max_y, ZComponent=0)  # -> Vector, Length
addition = Addition(A=vec.Vector, B=vec_2.Vector)

# ----
slider = CreateSlider(Slider=node_size, ShowBounds=False, ShowTicks=False, ShowTooltip=False, ShowValLabel=True, showLabel=True)
slider_2 = CreateSlider(Slider=graph_size, ShowBounds=False, ShowTicks=False, ShowTooltip=False, ShowValLabel=True, showLabel=True)
values = ValueListener(Elements=slider_2, SomeProperty=True)  # -> Values, Indices
values_2 = ValueListener(Elements=slider, SomeProperty=True)  # -> Values, Indices
all_node_types = Merge(
    Data1="Patient Room",
    Data2="Nurse Station",
    Data3="Utility Room",
    Data4="Elevator",
    Data5="Elevator Lobby",
    Data6="Medical Clinic",
    Data7="Pantry",
    Data8="Medication Room",
    Data9="Janitor Closet",
    Data10="None")
node_positions_trans = Move(Geometry=node_positions, Motion=addition)  # -> Geometry, Transform
layout_lines_trans = Move(Geometry=boundary_lines, Motion=addition)  # -> Geometry, Transform
graph_edge_lines_trans = Move(Geometry=graph_edge_lines, Motion=addition)  # -> Geometry, Transform

radiobtn = CreateRadioButton(RadioButtonName="Patient Room", RadioButtonGroup="node_type", InitiallySelected=False)
radiobtn_2 = CreateRadioButton(RadioButtonName="Nurse Station", RadioButtonGroup="node_type", InitiallySelected=False)
radiobtn_3 = CreateRadioButton(RadioButtonName="Utility Room", RadioButtonGroup="node_type", InitiallySelected=False)
radiobtn_4 = CreateRadioButton(RadioButtonName="Elevator", RadioButtonGroup="node_type", InitiallySelected=False)
radiobtn_5 = CreateRadioButton(RadioButtonName="Elevator Lobby", RadioButtonGroup="node_type", InitiallySelected=False)
radiobtn_6 = CreateRadioButton(RadioButtonName="Medical Clinic", RadioButtonGroup="node_type", InitiallySelected=False)
radiobtn_7 = CreateRadioButton(RadioButtonName="Pantry", RadioButtonGroup="node_type", InitiallySelected=False)
radiobtn_8 = CreateRadioButton(RadioButtonName="Medication Room", RadioButtonGroup="node_type", InitiallySelected=False)
radiobtn_9 = CreateRadioButton(RadioButtonName="Janitor Closet", RadioButtonGroup="node_type", InitiallySelected=False)
values_3 = ValueListener(Elements=radiobtn_9, SomeProperty=True)  # -> flatten(Values), Indices
values_4 = ValueListener(Elements=radiobtn_8, SomeProperty=True)  # -> flatten(Values), Indices
values_5 = ValueListener(Elements=radiobtn_4, SomeProperty=True)  # -> flatten(Values), Indices
values_6 = ValueListener(Elements=radiobtn_6, SomeProperty=True)  # -> flatten(Values), Indices
values_7 = ValueListener(Elements=radiobtn_7, SomeProperty=True)  # -> flatten(Values), Indices
values_8 = ValueListener(Elements=radiobtn, SomeProperty=True)  # -> flatten(Values), Indices
values_9 = ValueListener(Elements=radiobtn_2, SomeProperty=True)  # -> flatten(Values), Indices
values_10 = ValueListener(Elements=radiobtn_3, SomeProperty=True)  # -> flatten(Values), Indices
values_11 = ValueListener(Elements=radiobtn_5, SomeProperty=True)  # -> flatten(Values), Indices
radio_button_values = Merge(
    Data1=values_8.Values,
    Data2=values_9.Values,
    Data3=values_10.Values,
    Data4=values_5.Values,
    Data5=values_11.Values,
    Data6=values_6.Values,
    Data7=values_7.Values,
    Data8=values_4.Values,
    Data9=values_3.Values)
all_radio_buttons = Merge(
    Data1=radiobtn,
    Data2=radiobtn_2,
    Data3=radiobtn_3,
    Data4=radiobtn_4,
    Data5=radiobtn_5,
    Data6=radiobtn_6,
    Data7=radiobtn_7,
    Data8=radiobtn_8,
    Data9=radiobtn_9)

merge_non_interactive = Merge(Data1=flatten(layout_lines_trans.Geometry), Data2=flatten(graph_edge_lines_trans.Geometry))  # -> flatten(Result)
cir = Circle(Plane=node_positions_trans.Geometry, Radius=Slider(1, range=0..2))
non_interactive_shapes = CreateShapes(Shapes=merge_non_interactive, StrokeColor=RGB(0, 0, 0), Scale=1, ClickMode=3)
node_shapes = CreateShapes(Shapes=cir, StrokeColor=RGB(0, 0, 0), Scale=1, ClickMode=0)
bool = Boolean(True)
mindex = MemberIndex(Set=radio_button_values, Member=bool)  # -> Index, Count
item_2 = ListItem(List=all_node_types, Index=mindex.Index, Wrap=True)
values_12 = ValueListener(Elements=node_shapes, SomeProperty=True)  # -> Values, Indices

# ---- group: Default Colors
nurse_station_color = ColourSwatch(SwatchColor=RGB(228, 26, 114))
elevator_color = ColourSwatch(SwatchColor=RGB(12, 95, 49))
elevator_lobby_color = ColourSwatch(SwatchColor=RGB(147, 198, 128))
janitor_closet_color = ColourSwatch(SwatchColor=RGB(28, 69, 133))
none_color = ColourSwatch(SwatchColor=RGB(199, 199, 199))
patient_room_color = ColourSwatch(SwatchColor=RGB(65, 201, 220))
utility_room_color = ColourSwatch(SwatchColor=RGB(100, 41, 142))
medical_clinic_color = ColourSwatch(SwatchColor=RGB(1, 196, 114))
pantry_color = ColourSwatch(SwatchColor=RGB(188, 227, 51))
medication_room_color = ColourSwatch(SwatchColor=RGB(171, 200, 245))
all_colors = Merge(
    Data1=patient_room_color,
    Data2=nurse_station_color,
    Data3=utility_room_color,
    Data4=elevator_color,
    Data5=elevator_lobby_color,
    Data6=medical_clinic_color,
    Data7=pantry_color,
    Data8=medication_room_color,
    Data9=janitor_closet_color,
    Data10=none_color)

# ----
stack = CreateStack(UIElements=all_radio_buttons, Horizontal=False)
stack_2 = CreateStack(UIElements=[slider, slider_2], Horizontal=Toggle(False))
manage_graph_state = GhPythonScript(
    is_clicked_list=values_12.Values,
    node_position_list=node_positions,
    active_node_type=item_2,
    similarity_threshold=Slider(0.1, range=0..1),
    active_node_type_index=mindex.Index)  # -> out, new_active, new_node_type, is_true_update; inputs is_clicked_list: list of Boolean, node_position_list: list of Point3d
# ---------- manage_graph_state: Python ----------
__author__ = "rapha"
__version__ = "2024.03.25"

import rhinoscriptsyntax as rs
import Rhino.Geometry as rg
import os

def to_csv(data_dict, csv_sep=";"):
    """
    Writes a dictionary to csv format as a string.
    
    Args:
        data_dict (dict): A dictionary where keys are column headers and values are lists of column values.
        csv_sep (str, optional): The CSV separator, defaults to ";".
        
    Returns:
        str: A string in CSV format.
    """
    # Check if the dictionary is empty
    if not data_dict:
        return ""
    
    # Extract headers from the dictionary keys
    headers = list(data_dict.keys())
    
    # Ensure all columns have the same number of rows
    row_count = len(data_dict[headers[0]])
    for column in data_dict.values():
        if len(column) != row_count:
            raise ValueError("All columns must have the same number of rows")
    
    # Create the CSV string
    csv_string = csv_sep.join(headers) + "\n"  # Add the header row
    for i in range(row_count):
        row = [str(data_dict[header][i]) for header in headers]  # Convert each value to string to avoid issues
        csv_string += csv_sep.join(row) + "\n"  # Add the data rows
    
    return csv_string

def read_csv(csv_string, col_to_type, csv_sep=";"):
    """
    Parses a CSV-formatted string into a dictionary, converting columns to specified types.
    
    Args:
        csv_string (str): The CSV-formatted string to parse.
        types (list[type]): A list of types to which the column values will be converted. The order of types should match the order of columns in the CSV.
        csv_sep (str, optional): The CSV separator, defaults to ";".
        
    Returns:
        dict: A dictionary with column headers as keys and lists of typed values as values.
    """
    # Split the CSV string into lines
    lines = csv_string.strip().split("\n")
    
    # Extract the headers
    headers = lines[0].split(csv_sep)
    
    # Check if the number of columns matches the number of types provided
    for header in headers:
        try:
            col_to_type[header]
        except KeyError:
            raise Exception("Column `" + header + "` found in data, but missing in types")
    
    # Initialize the dictionary with headers and empty lists
    data_dict = {header: [] for header in headers}
    
    # Parse each row
    for line in lines[1:]:
        values = line.split(csv_sep)
        
        # Convert each value to the corresponding type and add it to the dict
        for header, value in zip(headers, values):
            typed_value = col_to_type[header](value)  # Convert to the specified type
            data_dict[header].append(typed_value)
    
    return data_dict

path = "C:\\Users\\rapha\\Desktop\\graph_state.txt"

# Check if file exists, otherwise create file with zero counts
if not os.path.exists(path):
    if not os.path.exists(os.path.dirname(path)):
        os.makedirs(os.path.dirname(path), exist_ok=True)
    with open(path, "w") as file:
        num_nodes = len(is_clicked_list)
        initial_data = {
            "node_type": num_nodes * [None],
            "active": num_nodes * [False],
            "x": [pos.X for pos in node_position_list],
            "y": [pos.Y for pos in node_position_list],
            "z": [pos.Z for pos in node_position_list]
        }
        with open(path, "w") as csv_file:
            csv_file.write(to_csv(initial_data))

# Load file.
with open(path, "r") as file:
    content = file.read()
old_data = read_csv(
    content,
    {
        "node_type": str,
        "active": eval,
        "x": float,
        "y": float,
        "z": float
    }
)

# Transform all "None" strings to actual None's
old_data["node_type"] = [None if s == "None" else s for s in old_data["node_type"]]

if "active_node_type_index_persist" not in globals():
    active_node_type_index_persist = active_node_type_index
if active_node_type_index_persist == active_node_type_index:
    # If the active node type has not changed, this is a true update
    is_true_update = True
else:
    # If the active node type has changed, this will trigger an update
    # but the update should not affect the graph state
    
    # Set current value
    active_node_type_index_persist = active_node_type_index
    
    is_true_update = False
if not is_true_update:
    print("is true update", is_true_update)

# Update data
new_data = dict(old_data)
for key in new_data:
    new_data[key] = []
for new_pos, is_clicked in zip(node_position_list, is_clicked_list):
    
    # Check if the exists a previously stored node at a similar position
    old_num_nodes = len(old_data["node_type"])
    exist_before_index = -1
    for i in range(old_num_nodes):
        old_x = old_data["x"][i]
        old_y = old_data["y"][i]
        old_z = old_data["z"][i]
        old_pos = rg.Point3d(old_x, old_y, old_z)
        distance = rs.Distance(new_pos, old_pos)
        if distance < similarity_threshold:
            exist_before_index = i
            break
    if exist_before_index == -1:
        # We add a new inactive node with no type associated with it
        new_data["node_type"].append("None")
        new_data["active"].append(False)
        new_data["x"].append(new_pos.X)
        new_data["y"].append(new_pos.Y)
        new_data["z"].append(new_pos.Z)
    else:
        # Update the position to current position
        new_data["x"].append(new_pos.X)
        new_data["y"].append(new_pos.Y)
        new_data["z"].append(new_pos.Z)
        
        # Get values to potentially update
        old_active = old_data["active"][exist_before_index]
        old_node_type = old_data["node_type"][exist_before_index]
        
        if not is_clicked or not is_true_update:
            # No update needed
            new_data["active"].append(old_active)
            new_data["node_type"].append(old_node_type)
            continue
        
        # If the previous node is active, but node type changed,
        # remain active, but change node type
        """
        if old_active and not old_node_type == active_node_type:
            print("switch direct")
            new_data["active"].append(old_active)
            new_data["node_type"].append(active_node_type)
        else:
            print("here")
            new_data["active"].append(bool((old_active + 1) % 2))
            new_data["node_type"].append(old_node_type)
        """
        if old_node_type == None or (old_active and old_node_type != active_node_type):
            new_data["active"].append(True)
            new_data["node_type"].append(active_node_type)
        elif old_active and old_node_type == active_node_type:
            new_data["active"].append(False)
            new_data["node_type"].append(None)

# Assert that all columns have the same number of elements
assert len(set([len(v) for _, v in new_data.items()])) == 1

new_active = [int(b) for b in new_data["active"]]
new_node_type = [t for t in new_data["node_type"]]

# Save state
with open(path, "w") as file:
    file.write(to_csv(new_data))
# ---------- end manage_graph_state ----------
panel_2 = Panel(manage_graph_state.is_true_update)
nullrep = ReplaceNulls(Items=manage_graph_state.new_node_type, Replacements="None")  # -> Items, Count

# ---- group: Node Label
mindex_2 = MemberIndex(Set=nullrep.Items, Member="None")  # -> Index, Count
replace = ReplaceItems(List=nullrep.Items, Indices=mindex_2.Index, Wrap=False)
label = CreateLabel(LabelText=replace, LabelSize=Slider(6.6, range=1..10), Justification=1)
vec_3 = VectorXYZ(XComponent=0, YComponent=Slider(0.5, range=0..1), ZComponent=0)  # -> Vector, Length
addition_2 = Addition(A=node_positions_trans.Geometry, B=vec_3.Vector)
addelem2shape = AddElementsToShapeS(ShapeToAddTo=non_interactive_shapes, ElementToAdd=label, ElementLocation=addition_2, Scale=values.Values)

# ---- group: Node Display in Rhino
mindex_3 = MemberIndex(Set=all_node_types, Member=nullrep.Items)  # -> flatten(Index), Count
item_3 = ListItem(List=all_colors, Index=mindex_3.Index, Wrap=True)
dots = DotDisplay(Point=nodes, Colour=item_3, Size=yti_node_size)

# ----
color_inactive = ColourSwatch(SwatchColor=RGB(168, 168, 168))
lng = ListLength(List=manage_graph_state.new_active)
mindex_4 = MemberIndex(Set=all_node_types, Member=nullrep.Items)  # -> flatten(Index), Count

lng_2 = ListLength(List=boundary_lines)
boundary_line_color = ColourSwatch(SwatchColor=RGB(0, 0, 0))
repeat = RepeatData(Data=boundary_line_color, Length=lng_2)

graph_edge_line_color = ColourSwatch(SwatchColor=RGB(168, 168, 168))
lng_3 = ListLength(List=graph_edge_lines)
repeat_2 = RepeatData(Data=graph_edge_line_color, Length=lng_3)

repeat_3 = RepeatData(Data=color_inactive, Length=lng)
active_color = ListItem(List=all_colors, Index=mindex_4.Index, Wrap=True)
p_n_c = PickNChoose(Pattern=manage_graph_state.new_active, Stream0=repeat_3, Stream1=active_color)
cir_2 = Circle(Plane=node_positions_trans.Geometry, Radius=values_2.Values)
node_colors = Colour(p_n_c)
non_interactive_colors = Merge(Data1=flatten(repeat), Data2=flatten(repeat_2))  # -> flatten(Result)

# ---- group: Create metric labels
label_2 = CreateLabel(LabelText="ICD: _", LabelSize=12, Justification=0)
label_3 = CreateLabel(LabelText="SCI: _", LabelSize=12, Justification=0)
label_4 = CreateLabel(LabelText="YTI: _", LabelSize=12, Justification=0)
toggle = BooleanToggle(False)

# ----
partitionbylabel = GhPythonScript(Labels=manage_graph_state.new_node_type, Points=node_positions)  # -> out, PatientRoom, NurseStation, UtilityRoom, Elevator, ElevatorLobby, MedicalClinic, Pantry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; inputs Labels: list, Points: list of Point3d
# ---------- partitionbylabel: Python ----------
__author__ = "rapha"
__version__ = "2022.03.31"

import rhinoscriptsyntax as rs

assert len(Labels) == len(Points)

# Hold the nodes.
PatientRoom = []
NurseStation = []
UtilityRoom = []
Elevator = []
ElevatorLobby = []
MedicalClinic = []
Pantry = []
MedicationRoom = []
JanitorCloset = []
Additional = []

# Mapping from names to containers.
map = {
    "Patient Room": PatientRoom,
    "Nurse Station": NurseStation,
    "Utility Room": UtilityRoom,
    "Elevator": Elevator,
    "Elevator Lobby": ElevatorLobby, 
    "Medical Clinic": MedicalClinic,
    "Pantry": Pantry,
    "Medication Room": MedicationRoom,
    "Janitor Closet": JanitorCloset
}

for i, label in enumerate(Labels):
    if label in map:
        map[label].append(Points[i])
    else:
        Additional.append(Points[i])
# ---------- end partitionbylabel ----------
setshapes = SetShapes(
    ShapeToModify=non_interactive_shapes,
    ShapeCurves=merge_non_interactive,
    StrokeColors=non_interactive_colors,
    Scale=values.Values)
setshapes_2 = SetShapes(ShapeToModify=node_shapes, ShapeCurves=cir_2, FillColors=node_colors, StrokeColors=RGB(0, 0, 0), Scale=values.Values)
number_slider_3 = Slider(19, range=0..100)
pt_4 = ConstructPoint(XCoordinate=number_slider_3, YCoordinate=number_slider_3, ZCoordinate=0)
pt_5 = ConstructPoint(XCoordinate=0, YCoordinate=0, ZCoordinate=0)
pline_2 = PolyLine(Vertices=[pt_5, pt_4], Closed=False)
pline_3 = PolyLine(Vertices=[pt_5, pt_4], Closed=False)
pline_4 = PolyLine(Vertices=[pt_5, pt_4], Closed=False)

patient_room = Point(partitionbylabel.PatientRoom)
janitor_closet = Point(partitionbylabel.JanitorCloset)
medical_clinic = Point(partitionbylabel.MedicalClinic)
nurse_station = Point(partitionbylabel.NurseStation)
utility_room = Point(partitionbylabel.UtilityRoom)
elevator_lobby = Point(partitionbylabel.ElevatorLobby)
additional = Point(partitionbylabel.Additional)
elevator = Point(partitionbylabel.Elevator)
medication_room = Point(partitionbylabel.MedicationRoom)
pantry = Point(partitionbylabel.Pantry)

yti_polyline = CreateShape(Shape=pline_2, StrokeColor=RGB(0, 0, 0), Scale=1)
sci_polyline = CreateShape(Shape=pline_3, StrokeColor=RGB(0, 0, 0), Scale=1)
icd_polyline = CreateShape(Shape=pline_4, StrokeColor=RGB(0, 0, 0), Scale=1)
dupln_2 = RemoveDuplicateLines(Lines=edges, Tolerance=0.01)
duppt = RemoveDuplicatePts(Points=nodes, Tolerance=0.01)
createlocationpairings = GhPythonScript(
    PatientRoom=patient_room,
    NurseStation=nurse_station,
    UtilityRoom=utility_room,
    Elevator=elevator,
    ElevatorLobby=elevator_lobby,
    MedicalClinic=medical_clinic,
    Pantry=pantry,
    MedicationRoom=medication_room,
    JanitorCloset=janitor_closet)  # -> out, PatientRoom_PatientRoom, NurseStation_PatientRoom, UtilityRoom_PatientRoom, NurseStation_UtilityRoom, NurseStation_Elevator, NurseStation_MedicalClinic, PatientRoom_Pantry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; inputs PatientRoom: list of Point3d, NurseStation: list of Point3d, UtilityRoom: list of Point3d, Elevator: list of Point3d, ElevatorLobby: list of Point3d, MedicalClinic: list of Point3d, Pantry: list of Point3d, MedicationRoom: list of Point3d, JanitorCloset: list of Point3d
# ---------- createlocationpairings: Python ----------
__author__ = "rapha"
__version__ = "2021.10.07"

import rhinoscriptsyntax as rs

def create_pairs(set1, set2, lines):
    for i in range(len(set1)):
        for j in range(len(set2)):
            p1 = set1[i]
            p2 = set2[j]
            
            # Do not consider paths that are too short.
            if rs.Distance(p1, p2) < 0.1:
                continue
            
            # Add a line between both locations.
            lines.append(rs.AddLine(p1, p2))

# Sets of pairs (connected by lines).
PatientRoom_PatientRoom = []
NurseStation_PatientRoom = []
UtilityRoom_PatientRoom = []
NurseStation_UtilityRoom = []
NurseStation_Elevator = []
NurseStation_MedicalClinic = []
PatientRoom_Pantry = []
PatientRoom_Elevator = []
MedicationRoom_PatientRoom = []
UtilityRoom_ElevatorLobby = []
UtilityRoom_MedicalClinic = []
UtilityRoom_Pantry = []
UtilityRoom_JanitorCloset = []
NurseStation_Pantry = []

# Fill pairs.
create_pairs(PatientRoom, PatientRoom, PatientRoom_PatientRoom)
create_pairs(NurseStation, PatientRoom, NurseStation_PatientRoom)
create_pairs(UtilityRoom, PatientRoom, UtilityRoom_PatientRoom)
create_pairs(NurseStation, UtilityRoom, NurseStation_UtilityRoom)
create_pairs(NurseStation, Elevator, NurseStation_Elevator)
create_pairs(NurseStation, MedicalClinic, NurseStation_MedicalClinic)
create_pairs(PatientRoom, Pantry, PatientRoom_Pantry)
create_pairs(PatientRoom, Elevator, PatientRoom_Elevator)
create_pairs(MedicationRoom, PatientRoom, MedicationRoom_PatientRoom)
create_pairs(UtilityRoom, ElevatorLobby, UtilityRoom_ElevatorLobby)
create_pairs(UtilityRoom, MedicalClinic, UtilityRoom_MedicalClinic)
create_pairs(UtilityRoom, Pantry, UtilityRoom_Pantry)
create_pairs(UtilityRoom, JanitorCloset, UtilityRoom_JanitorCloset)
create_pairs(NurseStation, Pantry, NurseStation_Pantry)
# ---------- end createlocationpairings ----------

# ---- group: Grid Definition
row_span = Panel("""1
1
1
3
1
1
1
1
1
1""")
row_relative_sizes = Panel("""1*
1*
1*
10*""")
row_definition = Panel("""3
3
3
0
0
1
2
0
1
2""")
merge = Merge(
    Data1=flatten(non_interactive_shapes),
    Data2=flatten(node_shapes),
    Data3=flatten(stack),
    Data4=flatten(stack_2),
    Data5=flatten(label_2),
    Data6=label_3,
    Data7=label_4,
    Data8=yti_polyline,
    Data9=sci_polyline,
    Data10=icd_polyline)  # -> flatten(Result)
column_relative_sizes = Panel("""2*
1*
1*""")
column_definition = Panel("""0
0
2
0
1
1
1
2
2
2""")
column_span = Panel("""2
2
1
1
1
1
1
1
1
1""")
grid = CreateGrid(
    UIElements=merge,
    RowDefinitions=row_relative_sizes,
    ColumnDefinitions=column_relative_sizes,
    ElementRow=row_definition,
    ElementColumn=column_definition,
    ElementRowSpan=row_span,
    ElementColumnSpan=column_span)

# ----
python = GhPythonScript(nodes=duppt, edges=dupln_2)  # -> out, ICD, contributing_nodes, contributing_degrees; inputs nodes: list of Point3d, edges: list of Curve
# ---------- python: Python ----------
__author__ = "rapha"
__version__ = "2021.10.08"

import rhinoscriptsyntax as rs

end_points = []

for edge in edges:
    start_point = rs.CurveStartPoint(edge)
    end_point = rs.CurveEndPoint(edge)
    both = [start_point, end_point]
    end_points.append(both)

node_degrees = []
contributing = 0
contributing_degrees = []
contributing_nodes = []
min_degree = float("inf")
max_degree = 0
for node in nodes:
    degree = 0
    for end_point in end_points:
        s = end_point[0]
        e = end_point[1]
        if (rs.Distance(node, s) < 0.1 or rs.Distance(node, e) < 0.1):
            degree += 1
    node_degrees.append(degree)
    if degree > 0:
        if degree < min_degree:
            min_degree = degree
        if degree > max_degree:
            max_degree = degree
        contributing_degrees.append(degree)
        contributing_nodes.append(node)
        contributing += 1
print(node_degrees)
ICD = sum(contributing_degrees) / contributing
# ---------- end python ----------

closepathtomedialaxis = CSharpScript(medialAxisCurveList=edges, nodePoint3dList=node_positions)  # -> out, connectingCurveList; inputs medialAxisCurveList: list of Curve, nodePoint3dList: list of Point3d
# ---------- closepathtomedialaxis: C# ----------
    // Check.
    List<Curve> result = new List<Curve>();
    foreach (Point3d node in nodePoint3dList)
    {
      if (node == null)
      {
        continue;
      }
      Point3d closestPoint = new Point3d();
      double minDist = double.MaxValue;
      double minParam = -1.0;
      Curve minCurve = medialAxisCurveList[0];

      // Find the closest point over all medial axis curves.
      foreach (Curve medialAxisCurve in medialAxisCurveList)
      {
        if (medialAxisCurve == null)
        {
          continue;
        }
        double closeParam;
        medialAxisCurve.ClosestPoint(node, out closeParam);
        Point3d closePoint = medialAxisCurve.PointAt(closeParam);
        double dist = node.DistanceTo(closePoint);
        if (dist < minDist)
        {
          closestPoint = closePoint;
          minDist = dist;
          minParam = closeParam;
          minCurve = medialAxisCurve;
        }
      }

      // We need to split the curve and add the split segment to the list as well.
      Curve[] splitMedialAxisCurves = minCurve.Split(minParam);
      if (splitMedialAxisCurves == null)
      {
        continue;
      }
      foreach (Curve splitCurve in splitMedialAxisCurves)
      {
        result.Add(splitCurve);
      }

      // Construct connecting curve to closest point.
      result.Add(new LineCurve(node, closestPoint));
    }
    connectingCurveList = result;
# ---------- end closepathtomedialaxis ----------
scriptpar_2 = ScriptParasite(Enable=False, Folder="C:\Users\rapha\Documents\ebdwebsite.github.io\toolkit\scripts")

python_2 = GhPythonScript(values=python.contributing_degrees)  # -> out, transformed_values
# ---------- python_2: Python ----------
__author__ = "rapha"
__version__ = "2023.09.20"

import rhinoscriptsyntax as rs

transformed_values = 5 * values
# ---------- end python_2 ----------
material = CreateMaterial(
    Diffuse=ColourSwatch(SwatchColor=RGB(0, 0, 0)),
    Specular=RGB(255, 255, 255),
    Emission=RGB(0, 0, 0),
    Transparency=0,
    Shine=0)
flatten = FlattenTree(Tree=createlocationpairings.PatientRoom_PatientRoom, Path="{0}")
flatten_2 = FlattenTree(Tree=createlocationpairings.NurseStation_PatientRoom, Path="{1}")
flatten_3 = FlattenTree(Tree=createlocationpairings.UtilityRoom_PatientRoom, Path="{2}")
flatten_4 = FlattenTree(Tree=createlocationpairings.NurseStation_UtilityRoom, Path="{3}")
flatten_5 = FlattenTree(Tree=createlocationpairings.NurseStation_Elevator, Path="{4}")
flatten_6 = FlattenTree(Tree=createlocationpairings.NurseStation_MedicalClinic, Path="{5}")
flatten_7 = FlattenTree(Tree=createlocationpairings.NurseStation_MedicalClinic, Path="{6}")
flatten_8 = FlattenTree(Tree=createlocationpairings.PatientRoom_Pantry, Path="{7}")
flatten_9 = FlattenTree(Tree=createlocationpairings.PatientRoom_Elevator, Path="{8}")
flatten_10 = FlattenTree(Tree=createlocationpairings.MedicationRoom_PatientRoom, Path="{9}")
flatten_11 = FlattenTree(Tree=createlocationpairings.UtilityRoom_ElevatorLobby, Path="{10}")
flatten_12 = FlattenTree(Tree=createlocationpairings.UtilityRoom_MedicalClinic, Path="{11}")
flatten_13 = FlattenTree(Tree=createlocationpairings.UtilityRoom_Pantry, Path="{12}")
flatten_14 = FlattenTree(Tree=createlocationpairings.NurseStation_Pantry, Path="{13}")
textdot = DefineTextDot(Text=python.contributing_degrees, Location=python.contributing_nodes, Font="Arial", Size=python_2.transformed_values)
previewlw = CustomPreviewLineweights(Geometry=dupln_2, Shader=material, Thickness=Slider(7.041, range=0..10), Absolute=False)
data = Data([flatten_2, flatten, flatten_14, flatten_13, flatten_3, flatten_12, flatten_4, flatten_11, flatten_5, flatten_10, flatten_6, flatten_9, flatten_7, flatten_8])
launchwin = LaunchWindow(Show=Toggle(True), Name="Control Window", Width=370, Height=400, ChildStatus=0, EnableHorizScroll=False)
viewer = ParamViewer(data)
int = Integer(1)
medialaxisandextensions = Curve(flatten(edges))
lng_4 = ListLength(List=viewer)
subtraction = Subtraction(A=lng_4, B=int)
dom = ConstructDomain(DomainStart=Slider(0, range=0..1), DomainEnd=Slider(1, range=0..1))
addelems = AddElements(Window=launchwin, Elements=grid, DoVLChecking=True)  # -> AddedElements, ElementNames
range = Range(Domain=dom, Steps=subtraction)
gradient = Gradient(
    LowerLimit=0,
    UpperLimit=1,
    Parameter=range,
    stops=[0: RGB(243, 57, 0), 0.1: RGB(236, 27, 60), 0.2: RGB(210, 0, 118), 0.3: RGB(103, 0, 120), 0.4: RGB(39, 72, 161), 0.5: RGB(1, 192, 229), 0.6: RGB(18, 178, 90), 0.7: RGB(79, 186, 8), 0.814: RGB(220, 237, 32), 1: RGB(247, 159, 20)])
probabilities_yti = ProbabilitiesYTI()  # -> p_patient_room_patient_room_2, p_nurse_station_patient_room_2, p_utility_room_patient_room_2, p_nurse_station_utility_room_2, p_nurse_station_elevator_2, p_nurse_station_medical_clinic_2, p_patient_room_pantry_2, p_patient_room_elevator_2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
col = Colour(gradient)

# ---- group: Shortest Paths
pr_pr = ShortestWalk(Curves=flatten(medialaxisandextensions), WantedPath=createlocationpairings.PatientRoom_PatientRoom)  # -> ShortestWalk, Succession, Direction, Length
ns_pr = ShortestWalk(Curves=flatten(medialaxisandextensions), WantedPath=createlocationpairings.NurseStation_PatientRoom)  # -> ShortestWalk, Succession, Direction, Length
ur_pr = ShortestWalk(Curves=flatten(medialaxisandextensions), WantedPath=createlocationpairings.UtilityRoom_PatientRoom)  # -> ShortestWalk, Succession, Direction, Length
ns_ur = ShortestWalk(Curves=flatten(medialaxisandextensions), WantedPath=createlocationpairings.NurseStation_UtilityRoom)  # -> ShortestWalk, Succession, Direction, Length
ns_e = ShortestWalk(Curves=flatten(medialaxisandextensions), WantedPath=createlocationpairings.NurseStation_Elevator)  # -> ShortestWalk, Succession, Direction, Length
ns_mc = ShortestWalk(Curves=flatten(medialaxisandextensions), WantedPath=createlocationpairings.NurseStation_MedicalClinic)  # -> ShortestWalk, Succession, Direction, Length
pr_p = ShortestWalk(Curves=flatten(medialaxisandextensions), WantedPath=createlocationpairings.PatientRoom_Pantry)  # -> ShortestWalk, Succession, Direction, Length
pr_e = ShortestWalk(Curves=flatten(medialaxisandextensions), WantedPath=createlocationpairings.PatientRoom_Elevator)  # -> ShortestWalk, Succession, Direction, Length
mr_pr = ShortestWalk(Curves=flatten(medialaxisandextensions), WantedPath=createlocationpairings.MedicationRoom_PatientRoom)  # -> ShortestWalk, Succession, Direction, Length
ur_el = ShortestWalk(Curves=flatten(medialaxisandextensions), WantedPath=createlocationpairings.UtilityRoom_ElevatorLobby)  # -> ShortestWalk, Succession, Direction, Length
ur_mc = ShortestWalk(Curves=flatten(medialaxisandextensions), WantedPath=createlocationpairings.UtilityRoom_MedicalClinic)  # -> ShortestWalk, Succession, Direction, Length
ur_p = ShortestWalk(Curves=flatten(medialaxisandextensions), WantedPath=createlocationpairings.UtilityRoom_Pantry)  # -> ShortestWalk, Succession, Direction, Length
ur_jc = ShortestWalk(Curves=flatten(medialaxisandextensions), WantedPath=createlocationpairings.UtilityRoom_JanitorCloset)  # -> ShortestWalk, Succession, Direction, Length
ns_p = ShortestWalk(Curves=flatten(medialaxisandextensions), WantedPath=createlocationpairings.NurseStation_Pantry)  # -> ShortestWalk, Succession, Direction, Length

# ----
flatten_15 = FlattenTree(Tree=pr_pr.ShortestWalk, Path="{0}")
flatten_16 = FlattenTree(Tree=ns_pr.ShortestWalk, Path="{1}")
flatten_17 = FlattenTree(Tree=ur_pr.ShortestWalk, Path="{2}")
flatten_18 = FlattenTree(Tree=ns_ur.ShortestWalk, Path="{3}")
flatten_19 = FlattenTree(Tree=ns_e.ShortestWalk, Path="{4}")
flatten_20 = FlattenTree(Tree=ns_mc.ShortestWalk, Path="{5}")
flatten_21 = FlattenTree(Tree=pr_p.ShortestWalk, Path="{6}")
flatten_22 = FlattenTree(Tree=pr_e.ShortestWalk, Path="{7}")
flatten_23 = FlattenTree(Tree=mr_pr.ShortestWalk, Path="{8}")
flatten_24 = FlattenTree(Tree=ur_el.ShortestWalk, Path="{9}")
flatten_25 = FlattenTree(Tree=ur_mc.ShortestWalk, Path="{10}")
flatten_26 = FlattenTree(Tree=ur_p.ShortestWalk, Path="{11}")
flatten_27 = FlattenTree(Tree=ur_jc.ShortestWalk, Path="{12}")
flatten_28 = FlattenTree(Tree=ns_p.ShortestWalk, Path="{13}")
mergedpathprobabilities = Merge(
    Data1=probabilities_yti.p_patient_room_patient_room_2,
    Data2=probabilities_yti.p_nurse_station_patient_room_2,
    Data3=probabilities_yti.p_utility_room_patient_room_2,
    Data4=probabilities_yti.p_nurse_station_utility_room_2,
    Data5=probabilities_yti.p_nurse_station_elevator_2,
    Data6=probabilities_yti.p_nurse_station_medical_clinic_2,
    Data7=probabilities_yti.p_patient_room_pantry_2,
    Data8=probabilities_yti.p_patient_room_elevator_2,
    Data9=probabilities_yti.p_medication_room_patient_room_2,
    Data10=probabilities_yti.p_utility_room_elevator_lobby_2,
    Data11=probabilities_yti.p_utility_room_medical_clinic_2,
    Data12=probabilities_yti.p_utility_room_pantry_2,
    Data13=probabilities_yti.p_utility_room_janitor_closet_2,
    Data14=probabilities_yti.p_nurse_station_pantry_2)
noise_domain = ConstructDomain(DomainStart=0, DomainEnd=noise_strength)
data_2 = Data([flatten_16, flatten_15, flatten_17, flatten_18, flatten_19, flatten_20, flatten_21, flatten_22, flatten_23, flatten_24, flatten_25, flatten_26, flatten_27, flatten_28])
len = Length(Curve=reference_line)
downscalelength = Division(A=reallength, B=len)
clean = CleanTree(RemoveNulls=True, RemoveInvalid=True, RemoveEmpty=True, Tree=data_2)
c_emitter = CurvyPointEmiter(Curve=pr_pr.ShortestWalk, Radius=noise_domain, Number=samples_per_curve, onframe=True, perp=True)  # -> flatten(Points)
python_3 = GhPythonScript(
    PR_PR=pr_pr.Succession,
    NS_PR=ns_pr.Succession,
    UR_PR=ur_pr.Succession,
    NS_UR=ns_ur.Succession,
    NS_E=ns_e.Succession,
    NS_MC=ns_mc.Succession,
    PR_P=pr_p.Succession,
    PR_E=pr_e.Succession,
    MR_PR=mr_pr.Succession,
    UR_EL=ur_el.Succession,
    UR_MC=ur_mc.Succession,
    UR_P=ur_p.Succession,
    UR_JC=ur_jc.Succession,
    NS_P=ns_p.Succession,
    MedaxCurves=medialaxisandextensions,
    PathProbabilities=mergedpathprobabilities,
    Width=yti_maximal_path_width,
    ColorPerPath=col)  # -> out, OutCurvesPlain, MidOffset, OutWidths, OutColors, PathTypes; inputs PR_PR: tree of Int32, NS_PR: tree of Int32, UR_PR: tree of Int32, NS_UR: tree of Int32, NS_E: tree of Int32, NS_MC: tree of Int32, PR_P: tree of Int32, PR_E: tree of Int32, MR_PR: tree of Int32, UR_EL: tree, UR_MC: tree, UR_P: tree of Int32, UR_JC: tree of Int32, NS_P: tree of Int32, MedaxCurves: list of Curve, PathProbabilities: list, ColorPerPath: list
# ---------- python_3: Python ----------
__author__ = "rapha"
__version__ = "2022.04.04"

import rhinoscriptsyntax as rs

path_types = [
    "PatientRoom_PatientRoom",
    "NurseStation_PatientRoom",
    "UtilityRoom_PatientRoom",
    "NurseStation_UtilityRoom",
    "NurseStation_Elevator",
    "NurseStation_MedicalClinic",
    "PatientRoom_Pantry",
    "PatientRoom_Elevator",
    "MedicationRoom_PatientRoom",
    "UtilityRoom_ElevatorLobby",
    "UtilityRoom_MedicalClinic",
    "UtilityRoom_Pantry",
    "UtilityRoom_JanitorCloset",
    "NurseStation_Pantry"
]

def tree_to_list(tree):
    if tree is None:
        return []
    return [list(tree.Branch(i)) for i in range(tree.BranchCount)]

# This is so fucking stupid, but still less stupid than Grasshopper's datatrees.
path_successions = {
    path_types[0]: tree_to_list(PR_PR),
    path_types[1]: tree_to_list(NS_PR),
    path_types[2]: tree_to_list(UR_PR),
    path_types[3]: tree_to_list(NS_UR),
    path_types[4]: tree_to_list(NS_E),
    path_types[5]: tree_to_list(NS_MC),
    path_types[6]: tree_to_list(PR_P),
    path_types[7]: tree_to_list(PR_E),
    path_types[8]: tree_to_list(MR_PR),
    path_types[9]: tree_to_list(UR_EL),
    path_types[10]: tree_to_list(UR_MC),
    path_types[11]: tree_to_list(UR_P),
    path_types[12]: tree_to_list(UR_JC),
    path_types[13]: tree_to_list(NS_P)
}

# Map medialaxis curves to the paths types that lead over it.
crv_to_path_type = {}
for path_type in path_types:
    successions = path_successions[path_type]
    for succession in successions:
        for crv_idx in succession:
            if crv_idx not in crv_to_path_type:
                crv_to_path_type[crv_idx] = [path_types.index(path_type)]
            else:
                if path_types.index(path_type) not in crv_to_path_type[crv_idx]:
                    crv_to_path_type[crv_idx].append(path_types.index(path_type))


for i, (key, val) in enumerate(crv_to_path_type.items()):
    print(str(i) + " | " + str(key) + ": " + str(val))

OutCurvesPlain = []
MidOffset = []
OutWidths = []
OutColors = []
PathTypes = []
for key, val in crv_to_path_type.items():
    width = Width * sum([PathProbabilities[idx] for idx in val])
    offset = -width / 2
    for path_type_idx in val:
        OutCurvesPlain.append(MedaxCurves[key])
        MidOffset.append(offset + Width * PathProbabilities[path_type_idx] / 2)
        OutWidths.append(Width * PathProbabilities[path_type_idx])
        OutColors.append(ColorPerPath[path_type_idx])
        PathTypes.append(path_type_idx)
        offset += Width * PathProbabilities[path_type_idx]
# ---------- end python_3 ----------
c_emitter_2 = CurvyPointEmiter(Curve=ns_pr.ShortestWalk, Radius=noise_domain, Number=samples_per_curve)  # -> flatten(Points)
c_emitter_3 = CurvyPointEmiter(Curve=mr_pr.ShortestWalk, Radius=noise_domain, Number=samples_per_curve)  # -> flatten(Points)
c_emitter_4 = CurvyPointEmiter(Curve=ns_mc.ShortestWalk, Radius=noise_domain, Number=samples_per_curve)  # -> flatten(Points)
computeyti = GhPythonScript(ShortestPaths=clean, PathProbabilities=mergedpathprobabilities, DownscaleLength=downscalelength)  # -> out, YTI; inputs ShortestPaths: tree of Curve, PathProbabilities: list
# ---------- computeyti: Python ----------
__author__ = "rapha"
__version__ = "2022.03.31"

import rhinoscriptsyntax as rs
import ghpythonlib.treehelpers as th

print(ShortestPaths.BranchCount)
shortest_paths = [list(ShortestPaths.Branch(i)) for i in range(ShortestPaths.BranchCount)]

# Not all path pairings are necessarily present.
# If a pairing is missing, the remaining path probabilities are upscaled to compensate.
p_mass = sum(PathProbabilities)
scale_factor = 1.0 / p_mass

YTI = 0
for i, sps in enumerate(shortest_paths):
    if len(sps) == 0:
        continue
    lens = [rs.CurveLength(crv) for crv in sps]
    avg_len = sum(lens) / len(lens)
    print(avg_len)
    print(PathProbabilities[i])
    YTI += scale_factor * PathProbabilities[i] * avg_len * DownscaleLength
# ---------- end computeyti ----------
measureindex = Integer(0)
isovist = Isovist(
    VantagePointS=c_emitter_2,
    ObstacleLines=flatten(dupln),
    ViewingDirection=Vector(0, 1, 0),
    ViewingRange=1000,
    ViewingAngle=360,
    Precision=360,
    ShowPolygon=True,
    ShowRadials=False,
    UseGPU=use_gpu)  # -> IsovistPolygon, Radials, ObstacleVisibility, IsovistProperties
isovist_2 = Isovist(
    VantagePointS=c_emitter_3,
    ObstacleLines=flatten(dupln),
    ViewingDirection=Vector(0, 1, 0),
    ViewingRange=1000,
    ViewingAngle=360,
    Precision=360,
    ShowPolygon=True,
    ShowRadials=False,
    UseGPU=use_gpu)  # -> IsovistPolygon, Radials, ObstacleVisibility, IsovistProperties
isovist_3 = Isovist(
    VantagePointS=c_emitter_4,
    ObstacleLines=flatten(dupln),
    ViewingDirection=Vector(0, 1, 0),
    ViewingRange=1000,
    ViewingAngle=360,
    Precision=360,
    ShowPolygon=True,
    ShowRadials=False,
    UseGPU=use_gpu)  # -> IsovistPolygon, Radials, ObstacleVisibility, IsovistProperties
isovist_4 = Isovist(
    VantagePointS=flatten(c_emitter),
    ObstacleLines=flatten(dupln),
    ViewingDirection=Vector(0, 1, 0),
    ViewingRange=1000,
    ViewingAngle=360,
    Precision=360,
    ShowPolygon=Toggle(False),
    ShowRadials=False,
    UseGPU=use_gpu)  # -> IsovistPolygon, Radials, ObstacleVisibility, IsovistProperties
offset = OffsetCurve(Curve=python_3.OutCurvesPlain, Distance=python_3.MidOffset, Corners=Slider(1, range=0..100))
path_mapper = PathMapper(offset, source="{A;B;C;D}", target="{D}")

# ---- group: SCI Computation / SCI: Probabilities of choosing a path
p_nursestation_medicalclinic = Number(5)
p_patientroom_nursestation = Number(29)
p_patientroom_patientroom = Number(37)
p_patientroom_medicationroom = Number(17)

# ---- group: SCI Computation
averageisovistmeasure = GhPythonScript(measuresPerPointTree=isovist_3.IsovistProperties, whichMeasure=measureindex)  # -> out, average, selectedMeasures, minimum, maximum; inputs measuresPerPointTree: tree
# ---------- averageisovistmeasure: Python ----------
__author__ = "rapha"
__version__ = "2021.10.08"

import rhinoscriptsyntax as rs
import ghpythonlib.treehelpers as th

measuresPerPoint = []
for i in range(measuresPerPointTree.BranchCount):
    measuresPerPoint.append(measuresPerPointTree.Branch(i))
selectedMeasures = [perPoint[whichMeasure] for perPoint in measuresPerPoint]
minimum = min(selectedMeasures)
maximum = max(selectedMeasures)
average = sum(selectedMeasures) / len(selectedMeasures)
# ---------- end averageisovistmeasure ----------
averageisovistmeasure_2 = GhPythonScript(measuresPerPointTree=isovist_2.IsovistProperties, whichMeasure=measureindex)  # -> out, average, selectedMeasures, minimum, maximum; inputs measuresPerPointTree: tree; same code as averageisovistmeasure
averageisovistmeasure_3 = GhPythonScript(measuresPerPointTree=isovist_4.IsovistProperties, whichMeasure=measureindex)  # -> out, average, selectedMeasures, minimum, maximum; inputs measuresPerPointTree: tree; same code as averageisovistmeasure
averageisovistmeasure_4 = GhPythonScript(measuresPerPointTree=isovist.IsovistProperties, whichMeasure=measureindex)  # -> out, average, selectedMeasures, minimum, maximum; inputs measuresPerPointTree: tree; same code as averageisovistmeasure
num = Number([averageisovistmeasure_3.minimum, averageisovistmeasure_4.minimum, averageisovistmeasure_2.minimum, averageisovistmeasure.minimum])
num_2 = Number([averageisovistmeasure_4.maximum, averageisovistmeasure_3.maximum, averageisovistmeasure_2.maximum, averageisovistmeasure.maximum])
multiplication_2 = Multiplication(A=averageisovistmeasure_3.average, B=p_patientroom_patientroom)
multiplication_3 = Multiplication(A=averageisovistmeasure_4.average, B=p_patientroom_nursestation)
multiplication_4 = Multiplication(A=averageisovistmeasure_2.average, B=p_patientroom_medicationroom)
multiplication_5 = Multiplication(A=averageisovistmeasure.average, B=p_nursestation_medicalclinic)
min = GhPythonScript(input=num)  # -> out, output; inputs input: list
# ---------- min: Python ----------
__author__ = "rapha"
__version__ = "2021.10.11"

import rhinoscriptsyntax as rs

output = min(input)
# ---------- end min ----------
max = GhPythonScript(input=num_2)  # -> out, output; inputs input: list
# ---------- max: Python ----------
__author__ = "rapha"
__version__ = "2021.10.11"

import rhinoscriptsyntax as rs

output = max(input)
# ---------- end max ----------
ma = MassAddition(Input=[multiplication_2, multiplication_3, multiplication_4, multiplication_5])  # -> Result, PartialResults
lng_5 = ListLength(List=patient_room)
division = Division(A=Slider(1, range=0..1), B=downscalelength)
num_3 = Number(2)
multiplication_6 = Multiplication(A=lng_5, B=number_of_beds_per_patient_room)
pow = Power(A=division, B=num_3)
division_2 = Division(A=ma.Result, B=multiplication_6)
division_3 = Division(A=division_2, B=pow)

# ----
python_4 = GhPythonScript(
    Curves=path_mapper,
    C_PR=patient_room_color,
    C_NS=nurse_station_color,
    C_UR=utility_room_color,
    C_E=elevator_color,
    C_EL=elevator_lobby_color,
    C_MC=medical_clinic_color,
    C_P=pantry_color,
    C_MR=medication_room_color,
    C_JC=janitor_closet_color,
    PathTypes=python_3.PathTypes,
    Widths=python_3.OutWidths,
    DashWidth=number_slider)  # -> out, Colors, OutWidths, OutCurves; inputs Curves: tree, C_PR: Color, C_NS: Color, C_UR: Color, C_E: Color, C_EL: Color, C_MC: Color, C_P: Color, C_MR: Color, C_JC: Color, PathTypes: list of Int32, Widths: list
# ---------- python_4: Python ----------
__author__ = "rapha"
__version__ = "2022.04.04"

import rhinoscriptsyntax as rs

def weighted_avg_color(A, B, t):
    r = t * A.R + (1 - t) * B.R
    g = t * A.G + (1 - t) * B.G
    b = t * A.B + (1 - t) * B.B
    return rs.CreateColor(r, g, b)

path_type_to_palette = {
    0: [C_PR],
    1: [C_NS, C_PR],
    2: [C_UR, C_PR],
    3: [C_NS, C_UR],
    4: [C_NS, C_E],
    5: [C_NS, C_MC],
    6: [C_PR, C_P],
    7: [C_PR, C_E],
    8: [C_MR, C_PR],
    9: [C_UR, C_EL],
    10: [C_UR, C_MC],
    11: [C_UR, C_P],
    12: [C_UR, C_JC],
    13: [C_NS, C_P]
}

curves_per_path = [list(Curves.Branch(i)) for i in range(Curves.BranchCount)]
print([len(v) for v in curves_per_path])

Colors = []
OutWidths = []
OutCurves = []
for i, crvs in enumerate(curves_per_path):
    new_crvs = []
    for j in range(len(crvs) - 1):
        crv = crvs[j]
        new_crvs.append(crv)
        new_crvs.append(rs.AddLine(rs.CurveEndPoint(crv), rs.CurveStartPoint(crvs[j + 1])))
    join_res = []
    if len(new_crvs) >= 2:
        join_res = rs.JoinCurves(new_crvs)
        print(len(join_res))
    else:
        join_res = crvs
    div_params = [rs.DivideCurveEquidistant(c, DashWidth, return_points=False) for c in join_res]
    subdivided = [rs.SplitCurve(c, p) for (c, p) in zip(join_res, div_params)]
    subdivided = [c for sublist in subdivided for c in sublist]
    for j, crv in enumerate(subdivided):
        OutCurves.append(crv)
        OutWidths.append(1.0 * Widths[i])
        path_type = PathTypes[i]
        if len(path_type_to_palette[path_type]) == 1:
            avg_color = path_type_to_palette[path_type][0]
        else:
            color_start, color_end = path_type_to_palette[path_type]
            avg_color = weighted_avg_color(color_start, color_end, j / (len(subdivided) - 1))
        # Colors.append(path_type_to_palette[path_type][j % len(path_type_to_palette[path_type])])
        Colors.append(avg_color)
# ---------- end python_4 ----------
filter = StreamFilter(Gate=visualize_yti, Stream1=python_4.OutCurves)
previewlw_2 = CustomPreviewLineweights(Geometry=filter, Shader=python_4.Colors, Thickness=python_4.OutWidths, Absolute=Toggle(True))
panel_3 = Panel("""[  0,   0,   3]
[ 34,  17,  80]
[ 94,  23, 127]
[151,  44, 127]
[211,  66, 109]
[248, 117,  92]
[254, 187, 128]
[251, 252, 191]""")
yti = Number(computeyti.YTI)
sci = Number(division_3)
icd = Number(python.ICD)
gradient_2 = Gradient(
    LowerLimit=min.output,
    UpperLimit=max.output,
    Parameter=averageisovistmeasure_3.selectedMeasures,
    stops=[0: RGB(0, 0, 3), 0.143: RGB(34, 17, 80), 0.286: RGB(94, 23, 127), 0.429: RGB(151, 44, 127), 0.571: RGB(211, 66, 109), 0.714: RGB(248, 117, 92), 0.857: RGB(254, 187, 128), 1: RGB(251, 252, 191)])
gradient_3 = Gradient(
    LowerLimit=min.output,
    UpperLimit=max.output,
    Parameter=averageisovistmeasure_4.selectedMeasures,
    stops=[0: RGB(0, 0, 3), 0.143: RGB(34, 17, 80), 0.286: RGB(94, 23, 127), 0.429: RGB(151, 44, 127), 0.571: RGB(211, 66, 109), 0.714: RGB(248, 117, 92), 0.857: RGB(254, 187, 128), 1: RGB(251, 252, 191)])
gradient_4 = Gradient(
    LowerLimit=min.output,
    UpperLimit=max.output,
    Parameter=averageisovistmeasure_2.selectedMeasures,
    stops=[0: RGB(0, 0, 3), 0.143: RGB(34, 17, 80), 0.286: RGB(94, 23, 127), 0.429: RGB(151, 44, 127), 0.571: RGB(211, 66, 109), 0.714: RGB(248, 117, 92), 0.857: RGB(254, 187, 128), 1: RGB(251, 252, 191)])
gradient_5 = Gradient(
    LowerLimit=min.output,
    UpperLimit=max.output,
    Parameter=averageisovistmeasure.selectedMeasures,
    stops=[0: RGB(0, 0, 3), 0.143: RGB(34, 17, 80), 0.286: RGB(94, 23, 127), 0.429: RGB(151, 44, 127), 0.571: RGB(211, 66, 109), 0.714: RGB(248, 117, 92), 0.857: RGB(254, 187, 128), 1: RGB(251, 252, 191)])
panel_4 = Panel("""YTI
SCI
ICD""")
merge_2 = Merge(Data1=flatten(yti), Data2=flatten(sci), Data3=flatten(icd))

# ---- group: Noise
number_slider_4 = Slider(0.5, range=0..1)

# ----
manage_metrics_state = GhPythonScript(current_measures=merge_2, measure_names=panel_4)  # -> out, measure_time_series; inputs current_measures: list, measure_names: list
# ---------- manage_metrics_state: Python ----------
__author__ = "rapha"
__version__ = "2024.04.02"

import rhinoscriptsyntax as rs
import os
from ghpythonlib import treehelpers as th

def to_csv(data_dict, csv_sep=";"):
    """
    Writes a dictionary to csv format as a string.
    
    Args:
        data_dict (dict): A dictionary where keys are column headers and values are lists of column values.
        csv_sep (str, optional): The CSV separator, defaults to ";".
        
    Returns:
        str: A string in CSV format.
    """
    # Check if the dictionary is empty
    if not data_dict:
        return ""
    
    # Extract headers from the dictionary keys
    headers = list(data_dict.keys())
    
    # Ensure all columns have the same number of rows
    row_count = len(data_dict[headers[0]])
    for column in data_dict.values():
        if len(column) != row_count:
            raise ValueError("All columns must have the same number of rows")
    
    # Create the CSV string
    csv_string = csv_sep.join(headers) + "\n"  # Add the header row
    for i in range(row_count):
        row = [str(data_dict[header][i]) for header in headers]  # Convert each value to string to avoid issues
        csv_string += csv_sep.join(row) + "\n"  # Add the data rows
    
    return csv_string

def read_csv(csv_string, col_to_type, csv_sep=";"):
    """
    Parses a CSV-formatted string into a dictionary, converting columns to specified types.
    
    Args:
        csv_string (str): The CSV-formatted string to parse.
        types (list[type]): A list of types to which the column values will be converted. The order of types should match the order of columns in the CSV.
        csv_sep (str, optional): The CSV separator, defaults to ";".
        
    Returns:
        dict: A dictionary with column headers as keys and lists of typed values as values.
    """
    # Split the CSV string into lines
    lines = csv_string.strip().split("\n")
    
    # Extract the headers
    headers = lines[0].split(csv_sep)
    
    # Check if the number of columns matches the number of types provided
    for header in headers:
        try:
            col_to_type[header]
        except KeyError:
            raise Exception("Column `" + header + "` found in data, but missing in types")
    
    # Initialize the dictionary with headers and empty lists
    data_dict = {header: [] for header in headers}
    
    # Parse each row
    for line in lines[1:]:
        values = line.split(csv_sep)
        
        # Convert each value to the corresponding type and add it to the dict
        for header, value in zip(headers, values):
            if value == "None":
                typed_value = None
            else:
                typed_value = col_to_type[header](value)  # Convert to the specified type
            data_dict[header].append(typed_value)
    
    return data_dict

path = "C:\\Users\\rapha\\Desktop\\measures_over_time.txt"

# Check if file exists, otherwise create file with zero counts
if not os.path.exists(path):
    if not os.path.exists(os.path.dirname(path)):
        os.makedirs(os.path.dirname(path), exist_ok=True)
    with open(path, "w") as file:
        initial_data = {meaure_name: [] for measure_name in measure_names}
        with open(path, "w") as csv_file:
            csv_file.write(to_csv(initial_data))

# Load data
with open(path, "r") as csv_file:
    old_data = read_csv(
    csv_file.read(),
    {measure_name: float for measure_name in measure_names}
)

# Add current values to data
new_data = dict(old_data)
for measure_name, measure in zip(measure_names, current_measures):
    new_data[measure_name].append(measure)

list_of_measures = [v for _, v in new_data.items()]
measure_time_series = th.list_to_tree(list_of_measures)

# Save values
with open(path, "w") as csv_file:
    csv_file.write(to_csv(new_data))
# ---------- end manage_metrics_state ----------
python_5 = GhPythonScript(YTI=yti, SCI=sci, ICD=icd)  # -> out, strings
# ---------- python_5: Python ----------
__author__ = "rapha"
__version__ = "2021.10.08"

import rhinoscriptsyntax as rs

strings = []

if YTI:
    strings.append("YTI: " + str(round(YTI, 2)))
if SCI:
    strings.append("SCI: " + str(round(SCI, 2)))
if ICD:
    strings.append("ICD: " + str(round(ICD, 2)))
# ---------- end python_5 ----------

# ---- group: Update Labels
item_4 = ListItem(List=python_5.strings, Index=0, Wrap=True)
item_5 = ListItem(List=python_5.strings, Index=Slider(1, range=0..10), Wrap=True)
item_6 = ListItem(List=python_5.strings, Index=Slider(2, range=0..10), Wrap=True)
setlabel = SetLabelContents(LabelToModify=label_2, NewLabelContents=item_4)
setlabel_2 = SetLabelContents(LabelToModify=label_3, NewLabelContents=item_5)
setlabel_3 = SetLabelContents(LabelToModify=label_4, NewLabelContents=item_6)

# ----
neg = Negative(Value=number_slider_4)

# ---- group: Filtering Based On Visualization Selection
filter_2 = StreamFilter(Gate=visualize_sci, Stream1=c_emitter)
filter_3 = StreamFilter(Gate=visualize_sci, Stream1=c_emitter_2)
filter_4 = StreamFilter(Gate=visualize_sci, Stream1=c_emitter_3)
filter_5 = StreamFilter(Gate=visualize_sci, Stream1=c_emitter_4)

# ----
lng_6 = ListLength(List=filter_2)

# ---- group: Random X-Coords
dom_2 = ConstructDomain(DomainStart=neg, DomainEnd=number_slider_4)
random = Random(Range=dom_2, Number=lng_6, Seed=Slider(21, range=0..100))

# ---- group: Random Y-Coords
dom_3 = ConstructDomain(DomainStart=neg, DomainEnd=number_slider_4)
random_2 = Random(Range=dom_3, Number=lng_6, Seed=2)

# ----
create_line_plot = GhPythonScript(
    measure_time_series=manage_metrics_state.measure_time_series,
    y_height=Slider(25, range=10..1000),
    x_width=Slider(107, range=10..1000))  # -> out, geometry; inputs measure_time_series: tree
# ---------- create_line_plot: Python ----------
__author__ = "rapha"
__version__ = "2024.04.02"

import rhinoscriptsyntax as rs
from ghpythonlib import treehelpers as th

def create_geometry(values, x_width, y_height):
    output = []
    if len(values) < 2:
        output = None
    else:
        min_val = min([v for v in values if v])
        max_val = max([v for v in values if v])
        val_range = max_val - min_val if max_val != min_val else 1
        dx = x_width / (len(values) - 1)
        output = []
        for i, val in enumerate(values):
            if not val:
                point = rs.CreatePoint(i * dx, 0)
            else:
                point = rs.CreatePoint(i * dx, y_height * (val - min_val) / val_range)
            output.append(point)
    return output

ll_measures = th.tree_to_list(measure_time_series)

ll_geometry = []
for l in ll_measures:
    ll_geometry.append(create_geometry(l, x_width, y_height))
geometry = th.list_to_tree(ll_geometry)
# ---------- end create_line_plot ----------
pt_6 = ConstructPoint(XCoordinate=random, YCoordinate=random_2, ZCoordinate=0)
addition_3 = Addition(A=pt_6, B=filter_2)

# ---- group: Visualize SCI
cloud = CloudDisplay(Points=filter_3, Colours=gradient_3, Size=sci_vantage_point_size, SpriteType=1)
cloud_2 = CloudDisplay(Points=filter_4, Colours=gradient_4, Size=sci_vantage_point_size, SpriteType=1)
cloud_3 = CloudDisplay(Points=filter_5, Colours=gradient_5, Size=sci_vantage_point_size, SpriteType=1)
cloud_4 = CloudDisplay(Points=addition_3, Colours=gradient_2, Size=sci_vantage_point_size, SpriteType=1)

# ----
bang = ExplodeTree(Data=create_line_plot.geometry)  # -> Branch0, Branch1, Branch2
polyline_yti = PolyLine(Vertices=bang.Branch0, Closed=False)
polyline_sci = PolyLine(Vertices=bang.Branch1, Closed=False)
polyline_icd = PolyLine(Vertices=bang.Branch2, Closed=False)
setshape = SetShape(ShapeToModify=yti_polyline, ShapeCurve=polyline_yti, StrokeColor=RGB(0, 0, 0), Scale=1)
setshape_2 = SetShape(ShapeToModify=sci_polyline, ShapeCurve=polyline_sci, StrokeColor=RGB(0, 0, 0), Scale=1)
setshape_3 = SetShape(ShapeToModify=icd_polyline, ShapeCurve=polyline_icd, StrokeColor=RGB(0, 0, 0), Scale=1)

# ==== cluster ProbabilitiesYTI
p_utility_room_janitor_closet = Number(1.1)
p_utility_room_medical_clinic = Number(2.8)
p_nurse_station_medical_clinic = Number(5.8)
p_utility_room_elevator_lobby = Number(2.5)
p_nurse_station_utility_room = Number(9.8)
p_nurse_station_patient_room = Number(16.7)
p_utility_room_patient_room = Number(14.1)
p_nurse_station_elevator = Number(6.1)
p_patient_room_patient_room = Number(19.1)
p_patient_room_elevator = Number(3.7)
p_medication_room_patient_room = Number(4.8)
p_utility_room_pantry = Number(0.7)
p_nurse_station_pantry = Number(1)
p_patient_room_pantry = Number(4.6)
p_utility_room_pantry_2 = ClusterOutput(p_utility_room_pantry)
p_patient_room_pantry_2 = ClusterOutput(p_patient_room_pantry)
p_nurse_station_pantry_2 = ClusterOutput(p_nurse_station_pantry)
p_patient_room_elevator_2 = ClusterOutput(p_patient_room_elevator)
p_nurse_station_elevator_2 = ClusterOutput(p_nurse_station_elevator)
p_utility_room_patient_room_2 = ClusterOutput(p_utility_room_patient_room)
p_utility_room_janitor_closet_2 = ClusterOutput(p_utility_room_janitor_closet)
p_nurse_station_utility_room_2 = ClusterOutput(p_nurse_station_utility_room)
p_utility_room_medical_clinic_2 = ClusterOutput(p_utility_room_medical_clinic)
p_patient_room_patient_room_2 = ClusterOutput(p_patient_room_patient_room)
p_utility_room_elevator_lobby_2 = ClusterOutput(p_utility_room_elevator_lobby)
p_nurse_station_patient_room_2 = ClusterOutput(p_nurse_station_patient_room)
p_nurse_station_medical_clinic_2 = ClusterOutput(p_nurse_station_medical_clinic)
p_medication_room_patient_room_2 = ClusterOutput(p_medication_room_patient_room)
